# Grasshopper definition Example 1 - Offset complex polygon.gh (Grasshopper 0.9.75)
# plug-ins: ClipperComponents

# Example 1: A Complex (Self intersecting polygon)
panel = Panel("{10,20,0}")
amount_of_offsets = Slider(9, range=0..100)
kaleidoscope = Kaleidoscope(Geometry=panel, Plane=PlaneXY(0, 0, 0), Segments=10)  # -> Geometry, Transform
series = Series(Start=0, Step=0.9, Count=amount_of_offsets)
miter_distance = Slider(0, range=0..1000)
closed_fillet_type = ValueList({"Round": 0, "Square": 1, "Miter": 2}, selected="Miter")
polyline = PolyLine(Vertices=kaleidoscope.Geometry, Closed=True)
open_fillet_type = ValueList({"Round": 0, "Square": 1, "Butt": 2}, selected="Butt")
polygon_offset = PolygonOffset(
    Polylines=polyline,
    Distance=series,
    Plane=Plane(origin=(0, 0, 0), x=(0, 0, 0), y=(0, 0, 0)),
    Tolerance=0.01,
    ClosedFillet=closed_fillet_type,
    OpenFillet=open_fillet_type,
    Miter=miter_distance)  # -> Contour, Holes
curve = Curve(polygon_offset.Holes)
curve_2 = Curve(polygon_offset.Contour)
rendercurves = RenderCurves(Curve=curve_2, Color=ColourSwatch(SwatchColor=RGB(255, 0, 0)), Thickness=4)  # -> NoOutput; inputs Curve: Curve, Color: Color, Thickness: Int32
# ---------- rendercurves: C# ----------
    if (Curve == null || !Curve.IsValid)
    {
      return;
    }
    this.crv.Add(Curve);
    if (Color == null)
    {
      Color = Color.Black;
    }
    this.clr.Add(Color);
    if (Thickness == 0)
    {
      Thickness = 10;
    }
    this.thick.Add(Thickness);
# ---------- rendercurves: C# additional code ----------
  List<Curve> crv;
  List<Color> clr;
  List<int> thick;
  string error;


  //Return a BoundingBox that contains all the geometry you are about to draw.
  public override BoundingBox ClippingBox
  {
    get
    {
      return BoundingBox.Empty;
    }
  }

  //Draw all meshes in this method.
  public override void DrawViewportMeshes(IGH_PreviewArgs args)
  {
  }

  //Draw all wires and points in this method.
  public override void DrawViewportWires(IGH_PreviewArgs args)
  {
    try {

      for (int i = 0; i < crv.Count; i++)
      {
        args.Display.DrawCurve(this.crv[i], this.clr[i], this.thick[i]);
      }
    } catch (Exception e)
    {
      this.error = e.ToString();
    }
  }

  /// <summary>
  /// This method will be called once every solution, before any calls to RunScript.
  /// </summary>
  public override void BeforeRunScript()
  {
    crv = new List<Curve> ();
    clr = new List<Color> ();
    thick = new List<int> ();
  }
  /// <summary>
  /// This method will be called once every solution, after any calls to RunScript.
  /// </summary>
  public override void AfterRunScript()
  { }
# ---------- end rendercurves ----------
rendercurves_2 = RenderCurves(Curve=curve, Color=ColourSwatch(SwatchColor=RGB(0, 0, 255)), Thickness=4)  # -> NoOutput; inputs Curve: Curve, Color: Color, Thickness: Int32; same code as rendercurves
rendercurves_3 = RenderCurves(Curve=polyline, Thickness=3)  # -> NoOutput; inputs Curve: Curve, Color: Color, Thickness: Int32; same code as rendercurves
