# Grasshopper definition Example 2 - Simple urban plan.gh (Grasshopper 0.9.75)
# plug-ins: ClipperComponents

width_of_road = Slider(13, range=0..100)

# ----
# Just bunch of single lines
curve = Curve([<curve referenced from the Rhino model> x6])

# ----
# Buildings
polygon_offset = PolygonOffset(
    Polylines=curve,
    Distance=expr("x/2", width_of_road),
    Plane=Plane(origin=(0, 0, 0), x=(0, 0, 0), y=(0, 0, 0)),
    Tolerance=0.01,
    ClosedFillet=0,
    OpenFillet=2,
    Miter=2)  # -> Contour, Holes
height_of_buildings = Slider(25, range=0..100)
boundary_surfaces = BoundarySurfaces(Edges=polygon_offset.Holes)
unit_z = UnitZ(Factor=height_of_buildings)
extrude = Extrude(Base=boundary_surfaces, Direction=unit_z)

# ----
# Roads
height_of_curb = Slider(1, range=0..100)
unit_z_2 = UnitZ(Factor=height_of_curb)
boundary_surfaces_2 = BoundarySurfaces(Edges=[polygon_offset.Holes, polygon_offset.Contour])
extrude_2 = Extrude(Base=boundary_surfaces_2, Direction=unit_z_2)
