# Grasshopper definition Example 3 - Moire.gh (Grasshopper 0.9.75)
# plug-ins: ClipperComponents

# Example 3: Moire effect with Curve Booleans
number_slider = Slider(30, range=0..100)
series = Series(Start=number_slider, Step=number_slider, Count=Slider(23, range=0..100))
rectangle = Rectangle({Plane=PlaneXY(-189.8191418, -163.7651639, 0), Size=Domain2(u=0..374.5585282, v=0..306.5030991)})
polygon_offset = PolygonOffset(
    Polylines=rectangle,
    Distance=series,
    Plane=Plane(origin=(0, 0, 0), x=(0, 0, 0), y=(0, 0, 0)),
    Tolerance=0.01,
    ClosedFillet=2,
    OpenFillet=1,
    Miter=25)  # -> Contour, Holes
division = Division(A=number_slider, B=3)
curve = Curve(flatten([rectangle, polygon_offset.Contour, polygon_offset.Holes]))
polygon_offset_2 = PolygonOffset(
    Polylines=flatten(curve),
    Distance=division,
    Plane=Plane(origin=(0, 0, 0), x=(0, 0, 0), y=(0, 0, 0)),
    Tolerance=0.01,
    ClosedFillet=2,
    OpenFillet=1,
    Miter=25)  # -> Contour, Holes
curve_2 = Curve([polygon_offset_2.Contour, polygon_offset_2.Holes])
rotate = Rotate(Geometry=curve_2, Angle=degrees(Slider(180, range=0..180)), Plane=PlaneXY(0, 0, 0))  # -> Geometry, Transform
polylineboolean = PolylineBoolean(
    A=rotate.Geometry,
    B=curve_2,
    BooleanType=0,
    Plane=Plane(origin=(0, 0, 0), x=(0, 0, 0), y=(0, 0, 0)),
    Tolerance=0.01,
    EvenOdd=True)
rendercurves = RenderCurves(Curve=polylineboolean, Color=ColourSwatch(SwatchColor=RGB(0, 0, 0)), Thickness=3)  # -> NoOutput; inputs Curve: Curve, Color: Color, Thickness: Int32
# ---------- rendercurves: C# ----------
    if (Curve == null || !Curve.IsValid)
    {
      return;
    }
    this.crv.Add(Curve);
    if (Color == null)
    {
      Color = Color.Black;
    }
    this.clr.Add(Color);
    if (Thickness == 0)
    {
      Thickness = 10;
    }
    this.thick.Add(Thickness);
# ---------- rendercurves: C# additional code ----------
  List<Curve> crv;
  List<Color> clr;
  List<int> thick;
  string error;


  //Return a BoundingBox that contains all the geometry you are about to draw.
  public override BoundingBox ClippingBox
  {
    get
    {
      return BoundingBox.Empty;
    }
  }

  //Draw all meshes in this method.
  public override void DrawViewportMeshes(IGH_PreviewArgs args)
  {
  }

  //Draw all wires and points in this method.
  public override void DrawViewportWires(IGH_PreviewArgs args)
  {
    try {

      for (int i = 0; i < crv.Count; i++)
      {
        args.Display.DrawCurve(this.crv[i], this.clr[i], this.thick[i]);
      }
    } catch (Exception e)
    {
      this.error = e.ToString();
    }
  }

  /// <summary>
  /// This method will be called once every solution, before any calls to RunScript.
  /// </summary>
  public override void BeforeRunScript()
  {
    crv = new List<Curve> ();
    clr = new List<Color> ();
    thick = new List<int> ();
  }
  /// <summary>
  /// This method will be called once every solution, after any calls to RunScript.
  /// </summary>
  public override void AfterRunScript()
  { }
# ---------- end rendercurves ----------
