# Grasshopper definition Example 4 - Minkowski sums.gh (Grasshopper 0.9.75)
# plug-ins: ClipperComponents

curve = Curve(<curve referenced from the Rhino model>)
curve_2 = Curve(curve)
curve_3 = Curve(<curve referenced from the Rhino model>)
bounding_box = BoundingBox(Content=curve_2, Plane=PlaneXY(0, 0, 0))  # -> Box, Box_2
evaluate_box = EvaluateBox(Box=bounding_box.Box, UParameter=0.5, VParameter=0.5, WParameter=0.5)  # -> Plane, Point, Include
move = Move(Geometry=graft(curve_2), Motion=expr("-x", evaluate_box.Point))  # -> Geometry, Transform
rotate = Rotate(Geometry=move.Geometry, Angle=3.141592654, Plane=PlaneXY(0, 0, 0))  # -> Geometry, Transform
minkowski_sum = MinkowskiSum(
    A=curve_3,
    B=graft(rotate.Geometry),
    Plane=Plane(origin=(0, 0, 0), x=(0, 0, 0), y=(0, 0, 0)),
    Tolerance=Slider(0.141, range=0..10))  # -> Sum, DisplacedSum
point_on_curve = PointOnCurve(minkowski_sum.Sum, parameter=0)
move_2 = Move(Geometry=graft(move.Geometry), Motion=point_on_curve)  # -> Geometry, Transform
