# Grasshopper definition TestLibrary2.gh (Grasshopper 0.9.75)
# plug-ins: ClipperComponents

curve = Curve(<curve referenced from the Rhino model>)
series = Series(Start=5, Step=Slider(8, range=0..10), Count=Slider(25, range=0..100))
rectangle = Rectangle({Plane=PlaneXY(-47.20303275, 413.5165359, 0), Size=Domain2(u=0..290.5952679, v=0..206.7120978)})
curve_2 = Curve(curve)
polygon_offset = PolygonOffset(
    Polylines=rectangle,
    Distance=series,
    Plane=Plane(origin=(0, 0, 0), x=(0, 0, 0), y=(0, 0, 0)),
    Tolerance=0.01,
    ClosedFillet=1,
    OpenFillet=1,
    Miter=2)  # -> Contour, Holes
deconstruct_brep = DeconstructBrep(Brep=curve_2)  # -> Faces, Edges, Vertices
bounding_box = BoundingBox(Content=curve_2, Plane=PlaneXY(0, 0, 0), UnionBox=False)  # -> Box, Box_2
evaluate_box = EvaluateBox(Box=bounding_box.Box_2, UParameter="0.5", VParameter="0.5", WParameter="0.5")  # -> Plane, Point, Include
polygon_offset_2 = PolygonOffset(
    Polylines=[polygon_offset.Contour, polygon_offset.Holes],
    Distance=Slider(2, range=0..10),
    Plane=Plane(origin=(0, 0, 0), x=(0, 0, 0), y=(0, 0, 0)),
    Tolerance=0.01,
    ClosedFillet=1,
    OpenFillet=1,
    Miter=2)  # -> Contour, Holes
average = Average(Input=deconstruct_brep.Vertices)
curve_3 = Curve([polygon_offset_2.Contour, polygon_offset_2.Holes])
bounding_box_2 = BoundingBox(Content=flatten(curve_3), Plane=PlaneXY(0, 0, 0), UnionBox=True)  # -> Box, Box_2
curve_4 = Curve(<curve referenced from the Rhino model>)
number_slider = Slider(35, range=0..100)
rectangle_2 = Rectangle(Plane=PlaneXY(0, 0, 0), XSize=Domain(-1, 1), YSize=Domain(-2, 2), Radius=0)  # -> Rectangle, Length
curve_5 = Curve(<curve referenced from the Rhino model>)
boundary_surfaces = BoundarySurfaces(Edges=[polygon_offset_2.Contour, polygon_offset_2.Holes])
area = Area(Geometry=bounding_box_2.Box)  # -> Area, Centroid
curve_6 = Curve(curve_4)
curve_7 = Curve(<curve referenced from the Rhino model>)
point = Point()
curve_8 = Curve(curve_5)
rotate = Rotate(Geometry=boundary_surfaces, Angle=degrees(number_slider), Plane=area.Centroid)  # -> Geometry, Transform
rotate_2 = Rotate(Geometry=curve_3, Angle=degrees(number_slider), Plane=area.Centroid)  # -> Geometry, Transform
point_2 = Point(<point referenced from the Rhino model>)
bounding_box_3 = BoundingBox(Content=curve_6, Plane=PlaneXY(0, 0, 0))  # -> Box, Box_2
curve_9 = Curve(<curve referenced from the Rhino model>)
area_2 = Area(Geometry=curve_8)  # -> Area, Centroid
explode = Explode(Curve=curve_9, Recursive=True)  # -> Segments, Vertices
minkowski_difference = MinkowskiDifference(A=curve_7, B=curve_6, Plane=Plane(origin=(0, 0, 0), x=(0, 0, 0), y=(0, 0, 0)), Tolerance=0.01)
move = Move(Geometry=graft(curve_5), Motion=expr("-x", area_2.Centroid))  # -> Geometry, Transform
bounding_box_4 = BoundingBox(Content=curve_9, Plane=PlaneXY(0, 0, 0))  # -> Box, Box_2
move_2 = Move(Geometry=graft(curve_8), Motion=expr("-x", area_2.Centroid))  # -> Geometry, Transform
evaluate_box_2 = EvaluateBox(Box=bounding_box_3.Box, UParameter=0.5, VParameter=0.5, WParameter=0.5)  # -> Plane, Point, Include
polylineboolean = PolylineBoolean(
    A=flatten(rotate_2.Geometry),
    B=flatten(curve_3),
    BooleanType=0,
    Plane=Plane(origin=(0, 0, 0), x=(0, 0, 0), y=(0, 0, 0)),
    Tolerance=1e-05)
explode_2 = Explode(Curve=minkowski_difference, Recursive=True)  # -> Segments, Vertices
minkowski_sum = MinkowskiSum(A=curve_9, B=graft(curve_8), Plane=Plane(origin=(0, 0, 0), x=(0, 0, 0), y=(0, 0, 0)), Tolerance=0.0001)  # -> Sum, DisplacedSum
boundary_surfaces_2 = BoundarySurfaces(Edges=polylineboolean)  # disabled
rendercurves = RenderCurves(Curve=polylineboolean, Thickness=4)  # -> NoOutput; inputs Curve: Curve, Color: Color, Thickness: Int32; disabled
# ---------- rendercurves: C# ----------
    if (Curve == null || !Curve.IsValid)
    {
      return;
    }
    this.crv.Add(Curve);
    if (Color == null)
    {
      Color = Color.Black;
    }
    this.clr.Add(Color);
    if (Thickness == 0)
    {
      Thickness = 10;
    }
    this.thick.Add(Thickness);
# ---------- rendercurves: C# additional code ----------
  List<Curve> crv;
  List<Color> clr;
  List<int> thick;
  string error;


  //Return a BoundingBox that contains all the geometry you are about to draw.
  public override BoundingBox ClippingBox
  {
    get
    {
      return BoundingBox.Empty;
    }
  }

  //Draw all meshes in this method.
  public override void DrawViewportMeshes(IGH_PreviewArgs args)
  {
  }

  //Draw all wires and points in this method.
  public override void DrawViewportWires(IGH_PreviewArgs args)
  {
    try {

      for (int i = 0; i < crv.Count; i++)
      {
        args.Display.DrawCurve(this.crv[i], this.clr[i], this.thick[i]);
      }
    } catch (Exception e)
    {
      this.error = e.ToString();
    }
  }

  /// <summary>
  /// This method will be called once every solution, before any calls to RunScript.
  /// </summary>
  public override void BeforeRunScript()
  {
    crv = new List<Curve> ();
    clr = new List<Color> ();
    thick = new List<int> ();
  }
  /// <summary>
  /// This method will be called once every solution, after any calls to RunScript.
  /// </summary>
  public override void AfterRunScript()
  { }
# ---------- end rendercurves ----------
rotate_3 = Rotate(Geometry=minkowski_difference, Angle=3.141592654, Plane=PlaneXY(0, 0, 0))  # -> Geometry, Transform
move_3 = Move(Geometry=graft(curve_6), Motion=expr("-x", evaluate_box_2.Point))  # -> Geometry, Transform
mesh_from_polyline = MeshFromPolyline(x=polylineboolean)  # -> out, A; inputs x: Polyline; disabled
# ---------- mesh_from_polyline: C# ----------
    A = Mesh.CreateFromClosedPolyline(x);
# ---------- end mesh_from_polyline ----------
move_4 = Move(Geometry=curve_6, Motion=expr("-x", explode_2.Vertices))  # -> Geometry, Transform
list_item = ListItem(List=flatten(minkowski_sum.Sum), Index=0, Wrap=True)
list_item_2 = ListItem(List=explode.Segments, Index=0, Wrap=True)
polylineboolean_2 = PolylineBoolean(
    A=flatten(minkowski_sum.Sum),
    B=flatten(minkowski_sum.Sum),
    BooleanType=1,
    Plane=Plane(origin=(0, 0, 0), x=(0, 0, 0), y=(0, 0, 0)),
    Tolerance=0.001)
rotate_4 = Rotate(Geometry=move_3.Geometry, Angle=3.141592654, Plane=PlaneXY(0, 0, 0))  # -> Geometry, Transform
end_points = EndPoints(Curve=move.Geometry)  # -> Start, End
divide_curve = DivideCurve(Curve=list_item, Count=Slider(200, range=0..1000), Kinks=False)  # -> Points, Tangents, Parameters
rendercurves_2 = RenderCurves(Curve=list_item_2)  # -> NoOutput; inputs Curve: Curve, Color: Color, Thickness: Int32; same code as rendercurves
minkowski_sum_2 = MinkowskiSum(
    A=curve_7,
    B=graft(rotate_4.Geometry),
    Plane=Plane(origin=(0, 0, 0), x=(0, 0, 0), y=(0, 0, 0)),
    Tolerance=Slider(0.141, range=0..10))  # -> Sum, DisplacedSum
move_5 = Move(Geometry=graft(move.Geometry), Motion=divide_curve.Points)  # -> Geometry, Transform
point_on_curve = PointOnCurve(polylineboolean_2, parameter=0)
polylineboolean_3 = PolylineBoolean(
    A=move_5.Geometry,
    B=move_5.Geometry,
    BooleanType=1,
    Plane=Plane(origin=(0, 0, 0), x=(0, 0, 0), y=(0, 0, 0)),
    Tolerance=0.001)
list_item_3 = ListItem(List=minkowski_sum_2.Sum, Index=0, Wrap=True)
end_points_2 = EndPoints(Curve=curve_9)  # -> Start, End
move_6 = Move(Geometry=graft(curve_5), Motion=point_on_curve)  # -> Geometry, Transform
point_on_curve_2 = PointOnCurve(list_item_3, parameter=0.967)
convex_hull = ConvexHull(Plane=PlaneXY(0, 0, 0))  # -> Hull, HullZ, Indices
move_7 = Move(Geometry=graft(move_3.Geometry), Motion=point_on_curve_2)  # -> Geometry, Transform
